# Dynamo graph VAV Placement.dyn (Dynamo 1.3.1.1736)

family_types = FamilyTypes("VAV_Box_Sizes_4-16:08\" Size Box")
all_elements_in_active_view = ElementsInView()
categories = Categories("Doors")
byCategory = Revit.ElementFilter.ByCategory(all_elements_in_active_view, categories)
getLocation = Element.GetLocation(byCategory)
facingOrientation = FamilyInstance.FacingOrientation(byCategory)
add = Point.Add(point=getLocation, vectorToAdd=facingOrientation)
reverse = Vector.Reverse(facingOrientation)
add_2 = Point.Add(point=getLocation, vectorToAdd=reverse)
create = List.Create(add, add_2)
transpose = List.Transpose(create)
select_phase = RevitPhases("New Construction")
spaceAtPoint = Custom[SpaceAtPoint](Point=transpose@@L1, Phase=select_phase)  # Returns the space at the location of the point. Returns null if no space is there
code_block = CodeBlock { "Room Name"; }
getParameterValueByName = Element.GetParameterValueByName(element=spaceAtPoint, parameterName=code_block)
code_block_2 = CodeBlock(x=getParameterValueByName) { x=="CORRIDOR"; }
filterByBoolMask = List.FilterByBoolMask(list=spaceAtPoint, mask=code_block_2)
flatten = Flatten(filterByBoolMask.out)
duplicateItemIndicies = archilab.Lists.Lists.DuplicateItemIndicies(flatten)
removeItemAtIndex = List.RemoveItemAtIndex(list=getLocation, indices=duplicateItemIndicies.out1)
door_location_watch = Watch(getLocation)
removeItemAtIndex_2 = List.RemoveItemAtIndex(list=door_location_watch, indices=duplicateItemIndicies.out1)
filterByBoolMask_2 = List.FilterByBoolMask(list=transpose, mask=code_block_2)
flatten_2 = Flatten(filterByBoolMask_2.out)
removeItemAtIndex_3 = List.RemoveItemAtIndex(list=flatten_2, indices=duplicateItemIndicies.out1)
byTwoPoints = Vector.ByTwoPoints(start=removeItemAtIndex_2, end=removeItemAtIndex_3)
flatten_3 = Flatten(byTwoPoints)
code_block_3 = CodeBlock { 4; }
translate = Geometry.Translate(geometry=removeItemAtIndex, direction=flatten_3, distance=code_block_3)
byPoint = FamilyInstance.ByPoint(familyType=family_types, point=translate)
code_block_4 = CodeBlock(x=getParameterValueByName) { x=="CORRIDOR"; }
if_ = If(test=code_block_4, true=transpose, false=getLocation)
filterByBoolMask_3 = List.FilterByBoolMask(list=if_, mask=code_block_4)
byTwoPoints_2 = Vector.ByTwoPoints(start=getLocation, end=filterByBoolMask_3.in)
flatten_4 = Flatten(byTwoPoints_2)
removeItemAtIndex_4 = List.RemoveItemAtIndex(list=flatten_4, indices=duplicateItemIndicies.out1)
code_block_5 = CodeBlock { 0; 1; 0; }
byCoordinates = Vector.ByCoordinates(x=code_block_5.out0, y=code_block_5.out1, z=code_block_5.out2)
ZAxis = Vector.ZAxis()
angleAboutAxis = Vector.AngleAboutAxis(removeItemAtIndex_4, byCoordinates, ZAxis)
code_block_6 = CodeBlock { 90; }
roundToPrecision = Custom[Math.Round+](dbl=angleAboutAxis, precision=code_block_6)  # "Math.RoundToPrecision"; Rounds a number to a specified precision
flatten_5 = Flatten(roundToPrecision)
setRotation = FamilyInstance.SetRotation(familyInstance=byPoint, degree=flatten_5)
